# Grasshopper definition Case600.gh (Grasshopper 1.0.7)

opaquematnomass = HBOpaqueMaterialNoMass(name="Int. Sur Coeff", r_value="0.121", therm_absp="0.9", sol_absp="0.6", vis_absp="0.6")  # -> mat; plug-in component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
opaquematnomass_2 = HBOpaqueMaterialNoMass(name="Ext. Sur Coeff", r_value="0.034", therm_absp="0.9", sol_absp="0.6", vis_absp="0.6")  # -> mat; plug-in component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
opaquemat = HBOpaqueMaterial(name="Plasterboard", thickness="0.012", conductivity="0.16", density="950", spec_heat="840")  # -> mat; plug-in component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
opaquemat_2 = HBOpaqueMaterial(name="Wood Siding", thickness="0.009", conductivity="0.14", density="530", spec_heat="900")  # -> mat; plug-in component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
opaquemat_3 = HBOpaqueMaterial(name="Fiberglass Quilt", thickness="0.066", conductivity="0.04", density="12", spec_heat="840")  # -> mat; plug-in component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
opaquematnomass_3 = HBOpaqueMaterialNoMass(name="Int. Sur Coeff", r_value="0.121", therm_absp="0.9", sol_absp="0.6", vis_absp="0.6")  # -> mat; plug-in component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
opaquematnomass_4 = HBOpaqueMaterialNoMass(name="Ext. Sur Coeff", r_value="0.034", therm_absp="0.9", sol_absp="0.6", vis_absp="0.6")  # -> mat; plug-in component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
opaquemat_4 = HBOpaqueMaterial(name="Plasterboard", thickness="0.01", conductivity="0.16", density="950", spec_heat="840")  # -> mat; plug-in component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
opaquemat_5 = HBOpaqueMaterial(name="Roof Deck", thickness="0.019", conductivity="0.14", density="530", spec_heat="900")  # -> mat; plug-in component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
opaquemat_6 = HBOpaqueMaterial(name="Fiberglass Quilt", thickness="0.1118", conductivity="0.04", density="12", spec_heat="840")  # -> mat; plug-in component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
opaquematnomass_5 = HBOpaqueMaterialNoMass(name="Int. Sur Coeff", r_value="0.121")  # -> mat; plug-in component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
opaquemat_7 = HBOpaqueMaterial(name="Timber Flooring", thickness="0.025", conductivity="0.14", density="650", spec_heat="1200")  # -> mat; plug-in component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
opaquemat_8 = HBOpaqueMaterial(name="Insulation", thickness="1.003", conductivity="0.04", density="10", spec_heat="1400")  # -> mat; plug-in component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
merge = Merge(Data1=opaquemat_8, Data2=opaquemat_7, Data3=opaquematnomass_5)
merge_2 = Merge(Data1=opaquematnomass, Data2=opaquemat, Data3=opaquemat_3, Data4=opaquemat_2, Data5=opaquematnomass_2)
merge_3 = Merge(Data1=opaquematnomass_4, Data2=opaquemat_5, Data3=opaquemat_6, Data4=opaquemat_4, Data5=opaquematnomass_3)
opaqueconstr = HBOpaqueConstruction(name="wall", materials=merge_2)  # -> constr; plug-in component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
opaqueconstr_2 = HBOpaqueConstruction(name="roof", materials=merge_3)  # -> constr; plug-in component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
opaqueconstr_3 = HBOpaqueConstruction(name="Floor", materials=merge)  # -> constr; plug-in component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
decnstrmat = HBDeconstructMaterial(mat=opaqueconstr)  # -> values, attr_names, r_val_si, r_val_ip; plug-in component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
decnstrmat_2 = HBDeconstructMaterial(mat=opaqueconstr_2)  # -> values, attr_names, r_val_si, r_val_ip; plug-in component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
decnstrmat_3 = HBDeconstructMaterial(mat=opaqueconstr_3)  # -> values, attr_names, r_val_si, r_val_ip; plug-in component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
panel = Panel(decnstrmat_3.r_val_si)
panel_2 = Panel(decnstrmat.r_val_si)
panel_3 = Panel(decnstrmat_2.r_val_si)
exteriorsubset = HBExteriorConstructionSubset(exterior_wall=opaqueconstr, exterior_roof=opaqueconstr_2)  # -> exterior_set; plug-in component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
groundsubset = HBGroundConstructionSubset(ground_floor=opaqueconstr_3)  # -> ground_set; plug-in component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
constructionset = HBConstructionSet(exterior_subset=exteriorsubset, ground_subset=groundsubset)  # -> constr_set; plug-in component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

# ---- group: Programme
constantschedule = HBConstantSchedule(values="27", type_limit="Temperature")  # -> report, schedule, idf_text; plug-in component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
constantschedule_2 = HBConstantSchedule(values="20", type_limit="Temperature")  # -> report, schedule, idf_text; plug-in component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
ach = Panel("0.5")
m3 = Panel("129.6")
s = Panel("3600")
multiplication = Multiplication(A=m3, B=ach)
division = Division(A=multiplication, B=s)
facade_area = Panel("75.6")
constantschedule_3 = HBConstantSchedule(values="1")  # -> report, schedule, idf_text; plug-in component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
setpoint = HBSetpoint(heating_sch=constantschedule_2.schedule, cooling_sch=constantschedule.schedule)  # -> setpoint; plug-in component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
m3_s_m2 = Division(A=division, B=facade_area)
division_2 = Division(A="200", B="48")
infiltration = HBInfiltration(flow_per_ext_area=m3_s_m2)  # -> infil; plug-in component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
equipment = HBEquipment(watts_per_area=division_2, schedule=constantschedule_3.schedule, radiant_fract="0.6")  # -> equip; plug-in component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
panel_4 = Panel(infiltration)
programtype = HBProgramType(electric_equip=equipment, infiltration=infiltration, setpoint=setpoint)  # -> program; plug-in component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

# ----
panel_5 = Panel("AIR")
glassmat = HBGlassMaterial(
    name="glass",
    thickness="0.003175",
    transmittance="0.86156",
    reflectance="0.07846",
    t_infrared="0",
    emiss_front="0.84",
    emiss_back="0.84",
    conductivity="1.06")  # -> mat; plug-in component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
glassmat_2 = HBGlassMaterial(
    name="glass",
    thickness="0.003175",
    transmittance="0.86156",
    reflectance="0.07846",
    t_infrared="0",
    emiss_front="0.84",
    emiss_back="0.84",
    conductivity="1.06")  # -> mat; plug-in component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
gapmat = HBWindowGapMaterial(name="air", thickness="0.013")  # -> mat; plug-in component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
merge_4 = Merge(Data1=glassmat_2, Data2=gapmat, Data3=glassmat)
windowconstr = HBWindowConstruction(name="window", materials=merge_4)  # -> constr; plug-in component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
decnstrmat_4 = HBDeconstructMaterial(mat=windowconstr)  # -> values, attr_names, r_val_si, r_val_ip; plug-in component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
panel_6 = Panel(decnstrmat_4.r_val_si)

panel_7 = Panel("C:\Users\mucd7\OneDrive - University of Missouri\Desktop\Rhino\Own\EP-BESTEST.epw")
importepw = LBImportEPW(epw_file=panel_7)  # -> location, dry_bulb_temperature, dew_point_temperature, relative_humidity, wind_speed, wind_direction, direct_normal_rad, diffuse_horizontal_rad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; plug-in component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
toggle = BooleanToggle(True)
createepw = DFCreateEPW(
    location=importepw.location,
    dry_bulb_temp=importepw.dry_bulb_temperature,
    dew_point_temp=importepw.dew_point_temperature,
    wind_speed=importepw.wind_speed,
    wind_direction=importepw.wind_direction,
    direct_normal_rad=importepw.direct_normal_rad,
    diffuse_horiz_rad=importepw.diffuse_horizontal_rad,
    direct_normal_ill=importepw.direct_normal_ill,
    diffuse_horiz_ill=importepw.diffuse_horizontal_ill,
    total_sky_cover=importepw.total_sky_cover,
    atmos_pressure=importepw.barometric_pressure,
    model_year=importepw.model_year,
    base_epw=panel_7,
    run=toggle)  # -> report, epw_obj; plug-in component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
panel_8 = Panel("C:\Users\mucd7\OneDrive - University of Missouri\Desktop\Rhino\Own")
writeepw = DFWriteEPW(epw_obj=createepw.epw_obj, folder=panel_8, file_name="DRYCOLD_denver", run=toggle)  # -> report, epw_file; plug-in component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

# ---- group: Geometry
windows = Brep([<brep referenced from the Rhino model> x2])
room = Brep(<brep referenced from the Rhino model>)
aperture = HBAperture(geo=windows, ep_constr=windowconstr)  # -> report, apertures; plug-in component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
roomsolid = HBRoomFromSolid(geo=flatten(room), constr_set=constructionset, program=programtype, conditioned=Toggle(True))  # -> report, rooms; plug-in component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

# ----
# https://climate.onebuilding.org/WMO_Region_4_North_and_Central_America/USA_United_States_of_America/CO_Colorado/USA_CO_Denver.Intl.AP.725650_US.Normals.2006-2020.zip
addsubface = HBAddSubface(hb_obj=flatten(roomsolid.rooms), sub_faces=flatten(aperture.apertures))  # -> hb_obj; plug-in component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
panel_9 = Panel("https://climate.onebuilding.org/WMO_Region_4_North_and_Central_America/USA_United_States_of_America/CO_Colorado/USA_CO_Denver.Intl.AP.725650_TMY3.zip")
idealair = HBIdealAir(rooms=flatten(addsubface), economizer="NoEconomizer")  # -> report, rooms; plug-in component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
panel_10 = Panel("""Site:GroundTemperature:BuildingSurface,
    10,                      !- January Ground Temperature {C}
    10,                      !- February Ground Temperature {C}
    10,                      !- March Ground Temperature {C}
    10,                      !- April Ground Temperature {C}
    10,                      !- May Ground Temperature {C}
    10,                      !- June Ground Temperature {C}
    10,                      !- July Ground Temperature {C}
    10,                      !- August Ground Temperature {C}
    10,                      !- September Ground Temperature {C}
    10,                      !- October Ground Temperature {C}
    10,                      !- November Ground Temperature {C}
    10;                      !- December Ground Temperature {C}""")
downloadepw = LBDownloadWeather(weather_URL=panel_9)  # -> epw_file, stat_file, ddy_file; plug-in component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
simoutput = HBSimulationOutput(load_type="Sensible")  # -> report, sim_output; plug-in component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
model = HBModel(rooms=flatten(idealair.rooms), name="Case 600")  # -> report, model; plug-in component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
simpar = HBSimulationParameter(output=simoutput.sim_output, timestep="4")  # -> sim_par; plug-in component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
vizbytype = HBVisualizeByType(hb_objs=model.model)  # -> walls, interior_walls, roofs, ceilings, exterior_floors, interior_floors, air_walls, apertures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; plug-in component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
toggle_2 = BooleanToggle(True)
modeltoosm = HBModelToOSM(model=model.model, epw_file=downloadepw.epw_file, sim_par=simpar, add_str=panel_10, write=toggle_2, run=toggle_2)  # -> report, jsons, osw, osm, idf, sql, zsz, rdd, html; plug-in component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
mesh = Mesh([vizbytype.exterior_floors, vizbytype.apertures, vizbytype.roofs])
eui = HBEndUseIntensity(sql=modeltoosm.sql)  # -> eui, eui_end_use, end_uses, gross_floor; plug-in component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
panel_11 = Panel(eui.eui_end_use)
panel_12 = Panel(eui.gross_floor)
item = ListItem(List=panel_11, Index=0, Wrap=True)
item_2 = ListItem(List=panel_11, Index="1", Wrap=True)
panel_13 = Panel(item)
multiplication_2 = Multiplication(A=item, B=panel_12)
multiplication_3 = Multiplication(A=item_2, B=panel_12)
panel_14 = Panel(item_2)
cooling = Panel(multiplication_3)
heating = Panel(multiplication_2)
